# Grasshopper definition KinergyMainInterface.gh (Grasshopper 1.0.7)
# plug-ins: Human UI, InstantExtension, KinergyUtilities

# ---- group: Playground for testing
c_script = CSharpScript()  # -> out, A
# ---------- c_script: C# ----------
    string str1 = System.AppDomain.CurrentDomain.BaseDirectory;
    A = str1;
# ---------- end c_script ----------
panel = Panel(c_script.A)

# ----
python = GhPythonScript()  # -> out, a
# ---------- python: Python ----------
__author__ = "lianghe"
__version__ = "2020.04.19"

import rhinoscriptsyntax as rs

import os

pre_path = os.path.abspath('.')[:os.path.abspath('.').rfind('\\')]
a=pre_path+"\Plug-ins\Grasshopper\Components\Resources\images\ReciprocalMovingIcon.png"
# ---------- end python ----------
python_2 = GhPythonScript()  # -> out, a
# ---------- python_2: Python ----------
__author__ = "lianghe"
__version__ = "2020.04.19"

import rhinoscriptsyntax as rs

import os

pre_path = os.path.abspath('.')[:os.path.abspath('.').rfind('\\')]
a=pre_path+"\Plug-ins\Grasshopper\Components\Resources\images\ContinuousSpinningIcon.png"
# ---------- end python_2 ----------
python_3 = GhPythonScript()  # -> out, a
# ---------- python_3: Python ----------
__author__ = "lianghe"
__version__ = "2020.04.19"

import rhinoscriptsyntax as rs

import os

pre_path = os.path.abspath('.')[:os.path.abspath('.').rfind('\\')]
a=pre_path+"\Plug-ins\Grasshopper\Components\Resources\images\ContinuousLinearMovingIcon.png"
# ---------- end python_3 ----------
python_4 = GhPythonScript()  # -> out, a
# ---------- python_4: Python ----------
__author__ = "lianghe"
__version__ = "2020.04.19"

import rhinoscriptsyntax as rs

import os

pre_path = os.path.abspath('.')[:os.path.abspath('.').rfind('\\')]
a=pre_path+"\Plug-ins\Grasshopper\Components\Resources\images\InstantExtensionIcon.png"
# ---------- end python_4 ----------
python_5 = GhPythonScript()  # -> out, a
# ---------- python_5: Python ----------
__author__ = "lianghe"
__version__ = "2020.04.19"

import rhinoscriptsyntax as rs

import os

pre_path = os.path.abspath('.')[:os.path.abspath('.').rfind('\\')]
a=pre_path+"\Plug-ins\Grasshopper\Components\Resources\images\InstantSpinningIcon.png"
# ---------- end python_5 ----------
width = Slider(330, range=0..1000)
height = Slider(56, range=0..1000)
number_slider = Slider(0, range=0..100)

# ---- group: Intermittent Motion Group
python_6 = GhPythonScript()  # -> out, a
# ---------- python_6: Python ----------
__author__ = "lianghe"
__version__ = "2020.04.19"

import rhinoscriptsyntax as rs

import os

pre_path = os.path.abspath('.')[:os.path.abspath('.').rfind('\\')]
a=pre_path+"\Plug-ins\Grasshopper\Components\Resources\images\IntermittentHoppingIcon.png"
# ---------- end python_6 ----------
button = CreateButton(ImagePath=python_6.a, ButtonStyle=0)
adjustpos = AdjustElementPositioning(
    ElementsToAdjust=button,
    Margin="10,10,0,10",
    AbsolutePositioning=False,
    Width=width,
    Height=height,
    HorizontalAlignment=number_slider)
expander = CreateExpander(UIElements=button, Header="Intermittent Motion", Open=True)

# ----
values = ValueListener(Elements=button, SomeProperty=True)  # -> Values, Indices

# ---- group: Instant Motion Group
python_7 = GhPythonScript()  # -> out, a
# ---------- python_7: Python ----------
__author__ = "lianghe"
__version__ = "2020.04.19"

import rhinoscriptsyntax as rs

import os

pre_path = os.path.abspath('.')[:os.path.abspath('.').rfind('\\')]
a=pre_path+"\Plug-ins\Grasshopper\Components\Resources\images\InstantThrowingIcon.png"
# ---------- end python_7 ----------
button_2 = CreateButton(ImagePath=python_5.a, ButtonStyle=0)
button_3 = CreateButton(ImagePath=python_4.a, ButtonStyle=0)
button_4 = CreateButton(ImagePath=python_7.a, ButtonStyle=0)
adjustpos_2 = AdjustElementPositioning(
    ElementsToAdjust=button_4,
    Margin="10,10,0,10",
    AbsolutePositioning=False,
    Width=width,
    Height=height,
    HorizontalAlignment=number_slider)
merge = Merge(Data1=button_3, Data2=button_2, Data3=button_4)
values_2 = ValueListener(Elements=button_4, SomeProperty=True)  # -> Values, Indices
expander_2 = CreateExpander(UIElements=merge, Header="Instant Motion", Open=True)
values_3 = ValueListener(Elements=button_3, SomeProperty=True)  # -> Values, Indices
values_4 = ValueListener(Elements=button_2, SomeProperty=True)  # -> Values, Indices

# ---- group: Continuous Motion Group
button_5 = CreateButton(ImagePath=python_3.a, ButtonStyle=0)
button_6 = CreateButton(ImagePath=python_2.a, ButtonStyle=0)
button_7 = CreateButton(ImagePath=python.a, ButtonStyle=0)
adjustpos_3 = AdjustElementPositioning(
    ElementsToAdjust=button_7,
    Margin="10,10,0,10",
    AbsolutePositioning=False,
    Width=width,
    Height=height,
    HorizontalAlignment=number_slider)
adjustpos_4 = AdjustElementPositioning(ElementsToAdjust=[button_2, button_6], Margin="0,10,0,10", AbsolutePositioning=False, Width=width, Height=height)
merge_2 = Merge(Data1=button_5, Data2=button_6, Data3=button_7)
expander_3 = CreateExpander(UIElements=merge_2, Header="Continuous Motion", Open=True)
values_5 = ValueListener(Elements=button_5, SomeProperty=True)  # -> Values, Indices
values_6 = ValueListener(Elements=button_6, SomeProperty=True)  # -> Values, Indices
values_7 = ValueListener(Elements=button_7, SomeProperty=True)  # -> Values, Indices

# ---- group: Instant Motion Group (continued)
adjustpos_5 = AdjustElementPositioning(
    ElementsToAdjust=[button_3, button_5],
    Margin="10,10,0,10",
    AbsolutePositioning=False,
    Width=width,
    Height=height,
    HorizontalAlignment=number_slider)

# ---- group: MAIN WINDOW
merge_3 = Merge(Data1=expander_2, Data2=expander, Data3=expander_3)
launchwin = LaunchWindow(
    Show=Toggle(True),
    Name="Kinergy",
    Width=Slider(380, range=0..1000),
    Height=Slider(710, range=0..1000),
    ChildStatus=0,
    EnableHorizScroll=False)
addelems = AddElements(Window=launchwin, Elements=flatten(merge_3), DoVLChecking=True)  # -> AddedElements, ElementNames

# ----
selectchildwindow = GhPythonScript(
    c0=values_3.Values,
    c1=values_4.Values,
    c2=values_2.Values,
    c3=values.Values,
    c4=values_5.Values,
    c5=values_6.Values,
    c6=values_7.Values)  # -> c0_2, c1_2, c2_2, c3_2, c4_2, c5_2, c6_2; inputs c0: Boolean, c1: Boolean, c2: Boolean, c3: Boolean, c4: Boolean, c5: Boolean, c6: Boolean
# ---------- selectchildwindow: Python ----------
__author__ = "liang he"
__version__ = "2020.04.20"

import rhinoscriptsyntax as rs
def compareValue(a,b):
    if(a==b):
        return False;
    return True;

#Make persistent value to keep track of last value
if "lastValue" not in globals():
    lastValue=[c0,c1,c2,c3,c4,c5,c6];

#Check that current value is different from last value
newValue=[c0,c1,c2,c3,c4,c5,c6];
for i,val in enumerate(newValue):
    if val==True:
        lastValue=[False,False,False,False,False,False,False];
        lastValue[i]=True;
        break;
        
c0_2=lastValue[0];
c1_2=lastValue[1];
c2_2=lastValue[2];
c3_2=lastValue[3];
c4_2=lastValue[4];
c5_2=lastValue[5];
c6_2=lastValue[6];
# ---------- end selectchildwindow ----------

# ---- group: TOADD: CHILDWINDOW
ie_height = Slider(370, range=0..1000)
ie_width = Slider(310, range=0..1000)
launchwin_2 = LaunchWindow(Show=selectchildwindow.c6_2, Name="Reciprocal Moving", Width=370, Height=400, ChildStatus=0, EnableHorizScroll=False)
launchwin_3 = LaunchWindow(
    Show=selectchildwindow.c0_2,
    Name="Instant Extension Motion",
    Width=ie_width,
    Height=ie_height,
    ChildStatus=0,
    EnableHorizScroll=False)
launchwin_4 = LaunchWindow(
    Show=selectchildwindow.c1_2,
    Name="Instant Spinning Motion",
    Width=370,
    Height=400,
    ChildStatus=0,
    EnableHorizScroll=False)
launchwin_5 = LaunchWindow(
    Show=selectchildwindow.c5_2,
    Name="Continuous Spinning Motion",
    Width=370,
    Height=400,
    ChildStatus=0,
    EnableHorizScroll=False)
launchwin_6 = LaunchWindow(Show=selectchildwindow.c2_2, Name="Instant Throwing", Width=370, Height=400, ChildStatus=0, EnableHorizScroll=False)
launchwin_7 = LaunchWindow(
    Show=selectchildwindow.c4_2,
    Name="Continuous Linear Moving Motion",
    Width=370,
    Height=400,
    ChildStatus=0,
    EnableHorizScroll=False)
launchwin_8 = LaunchWindow(
    Show=selectchildwindow.c3_2,
    Name="Intermittent Hopping Motion",
    Width=370,
    Height=400,
    ChildStatus=0,
    EnableHorizScroll=False)
childwin = MakeChildWindow(ParentWindow=launchwin, ChildWindow=launchwin_3)
childwin_2 = MakeChildWindow(ParentWindow=launchwin, ChildWindow=launchwin_4)
childwin_3 = MakeChildWindow(ParentWindow=launchwin, ChildWindow=launchwin_6)
childwin_4 = MakeChildWindow(ParentWindow=launchwin, ChildWindow=launchwin_8)
childwin_5 = MakeChildWindow(ParentWindow=launchwin, ChildWindow=launchwin_7)
childwin_6 = MakeChildWindow(ParentWindow=launchwin, ChildWindow=launchwin_5)
childwin_7 = MakeChildWindow(ParentWindow=launchwin, ChildWindow=launchwin_2)

# ---- group: Instant Extension Window Style
compression = Slider(0.5, range=0..1)
strength = Slider(0.5, range=0..1)
height_2 = Slider(30, range=0..500)
slider = CreateSlider(Slider=compression, ShowBounds=False, ShowTicks=False, ShowTooltip=False, ShowValLabel=True, showLabel=True)
border_corner_radius = Slider(0, range=0..10)
adjustpos_6 = AdjustElementPositioning(ElementsToAdjust=slider, Margin="0,-10,0,0", AbsolutePositioning=False, Height=height_2)
thumbnail_width = Slider(100, range=0..1000)
title_size = Slider(11, range=0..20)
title_size_2 = Slider(16, range=0..20)
border_thickness = Slider(1, range=0..10)
panel_2 = Panel("This unit has three parts: a helical spring, a rod, and a locking mechanism. The spring can be compressed and locked and extends immediately once the lock is released.")
height_3 = Slider(30, range=0..500)
true_button = CreateTrueOnlyButton(ButtonName="Set Motion Direction", ButtonStyle=0)
python_8 = GhPythonScript()  # -> out, a
# ---------- python_8: Python ----------
__author__ = "lianghe"
__version__ = "2020.04.19"

import rhinoscriptsyntax as rs

import os

pre_path = os.path.abspath('.')[:os.path.abspath('.').rfind('\\')]
a=pre_path+"\Plug-ins\Grasshopper\Components\Resources\images\IE.png"
# ---------- end python_8 ----------
slider_2 = CreateSlider(Slider=strength, ShowBounds=False, ShowTicks=False, ShowTooltip=False, ShowValLabel=True, showLabel=True)
adjustpos_7 = AdjustElementPositioning(ElementsToAdjust=slider_2, Margin="25,0,0,0", AbsolutePositioning=False, Height=height_3)
height_4 = Slider(30, range=0..500)
width_2 = Slider(123, range=0..500)
height_5 = Slider(30, range=0..500)
width_3 = Slider(150, range=0..500)
image = CreateImage(ImageSource=python_8.a, ImageWidth=thumbnail_width, ImageHeight=thumbnail_width)
checkbox = CreateCheckbox(Label="Energy control lock", StartingValue=Toggle(False))
label = CreateLabel(LabelText="Instant Extension Unit", LabelSize=title_size_2, Justification=0)
tb = CreateTextBlock(Text=panel_2, TextSize=title_size, Justification=0)
merge_4 = Merge(Data1=true_button, Data2=checkbox, Data3=slider, Data4=slider_2)
button_8 = CreateButton(ButtonName="Preview Motion", ButtonStyle=0)
expander_4 = CreateExpander(UIElements=merge_4, Header="Motion Control & Design", Open=True)
height_6 = Slider(30, range=0..500)
adjustpos_8 = AdjustElementPositioning(ElementsToAdjust=label, Margin="110,-120,0,10", AbsolutePositioning=False)
adjustpos_9 = AdjustElementPositioning(ElementsToAdjust=tb, Margin="110,-90,10,10", AbsolutePositioning=False, Width=width_3)
adjustpos_10 = AdjustElementPositioning(ElementsToAdjust=checkbox, Margin="140,-50,0,10", AbsolutePositioning=False)
adjustpos_11 = AdjustElementPositioning(ElementsToAdjust=image, Margin="10,10,10,10", AbsolutePositioning=False)
adjustpos_12 = AdjustElementPositioning(ElementsToAdjust=true_button, Margin="-150,0,0,10", AbsolutePositioning=False, Width=width_2, Height=height_4)
true_button_2 = CreateTrueOnlyButton(ButtonName="Add Kinetic Unit", ButtonStyle=0)
adjustpos_13 = AdjustElementPositioning(ElementsToAdjust=button_8, Margin="180,-40,0,10", AbsolutePositioning=False, Height=height_5)
merge_5 = Merge(Data1=image, Data2=label, Data3=tb, Data4=expander_4, Data6=true_button_2, Data7=button_8)
adjustpos_14 = AdjustElementPositioning(ElementsToAdjust=true_button_2, Margin="-180,10,0,10", AbsolutePositioning=False, Height=height_6)
addelems_2 = AddElements(Window=launchwin_3, Elements=flatten(merge_5), DoVLChecking=True)  # -> AddedElements, ElementNames

# ---- group: Instant Extension Events
values_8 = ValueListener(Elements=slider, SomeProperty=True)  # -> Values, Indices
values_9 = ValueListener(Elements=slider_2, SomeProperty=True)  # -> Values, Indices
values_10 = ValueListener(Elements=true_button_2, SomeProperty=True)  # -> Values, Indices
values_11 = ValueListener(Elements=true_button, SomeProperty=True)  # -> Values, Indices
setdir = SetDirection(Select=values_11.Values)  # -> DirVector, ArrowCrv, SelectedBrep
ie = InstantExtension(
    Start=values_10.Values,
    Model=setdir.SelectedBrep,
    SpringDirection=setdir.DirVector,
    Energy=values_9.Values,
    Distance=values_8.Values)
preprocessie = _01ModelPreprocessOfIE(Motion=ie)  # -> Motion, SpringPositionCandidates
sp = SelectPosition(PositionCandidates=preprocessie.SpringPositionCandidates, Select=Toggle(True))
constructspring = _02ConstructSpringOfIE(Motion=preprocessie.Motion, SpringPosition=sp)  # -> Motion, LockDirectionCandidates, Spring
sd = SelectDirection(DirectionCandidates=constructspring.LockDirectionCandidates, Select=Toggle(True))
nickname = _03GenerateLockPositionCandidateOfIE(Motion=constructspring.Motion, LockDirection=sd)  # -> Motion, LockPositionCandidates
sp_2 = SelectPosition(PositionCandidates=nickname.LockPositionCandidates, Select=Toggle(True))
constructlock = _04ConstructLockOfIE(Motion=nickname.Motion, LockPosition=sp_2)  # -> Motion, Models
